# Grasshopper definition Pattern.gh (Grasshopper 1.0.7)

piece1 = Curve(<curve referenced from the Rhino model>)
piece4 = Curve(<curve referenced from the Rhino model>)
piece2 = Curve(<curve referenced from the Rhino model>)
piece3 = Curve(<curve referenced from the Rhino model>)
max = Slider(0.32, range=0..1)
max_2 = Slider(0.3, range=0..1)
position = Point(<point referenced from the Rhino model>)
position_2 = Point(<point referenced from the Rhino model>)
logo = Curve(<curve referenced from the Rhino model>)
logo_2 = Curve(<curve referenced from the Rhino model>)
scale = Slider(0.15, range=0..0.2)
max_3 = Slider(0.55, range=0..1)
position_3 = Point(<point referenced from the Rhino model>)
position_4 = Point(<point referenced from the Rhino model>)
max_4 = Slider(0.25, range=0..1)
cluster = Cluster(G=position, N=Slider(10, range=0..10), M=Slider(6, range=0..10), crv=piece2, max=max_2)
cluster_2 = Cluster(G=position_2, N=Slider(13, range=0..20), M=Slider(6, range=0..10), crv=piece1, max=max)
cluster_3 = Cluster(G=position_3, N=Slider(5, range=0..10), M=Slider(9, range=0..10), crv=logo_2, max=max_3)
cluster_4 = Cluster(G=position_4, N=Slider(6, range=0..10), M=Slider(18, range=0..20), crv=piece4, max=max_4)
max_5 = Slider(0.55, range=0..1)
position_5 = Point(<point referenced from the Rhino model>)
max_6 = Slider(0.4, range=0..1)
position_6 = Point(<point referenced from the Rhino model>)
logo_3 = Curve(<curve referenced from the Rhino model>)
cluster_5 = Cluster(G=position_5, N=Slider(8, range=0..15), M=Slider(5, range=0..10), crv=piece4, max=max_6)
cluster_6 = Cluster(G=position_6, N=Slider(5, range=0..10), M=Slider(9, range=0..10), crv=piece4, max=max_5)

# ==== cluster Cluster
G = ClusterInput()
N = ClusterInput()
M = ClusterInput()
crv = ClusterInput()
max = ClusterInput()
series = Series(Start=0, Step=1, Count=M)
series_2 = Series(Start=0, Step=1, Count=N)
crv_2 = Curve(crv)
Y = UnitY(Factor=series)
X = UnitX(Factor=series_2)
move = Move(Geometry=G, Motion=X)  # -> graft(Geometry), Transform
move_2 = Move(Geometry=move.Geometry, Motion=Y)  # -> flatten(Geometry), Transform
crv_cp = CurveClosestPoint(Point=move_2.Geometry, Curve=crv_2)  # -> Point, Parameter, Distance
incurve = PointInCurve(Point=move_2.Geometry, Curve=crv_2)  # -> Relationship, Point
dist = Distance(PointA=move_2.Geometry, PointB=crv_cp.Point)
equals = Equality(FirstNumber=incurve.Relationship, SecondNumber=0)  # -> Equality, Inequality
multiplication = Multiplication(A=equals.Equality, B=dist)
sort = SortList(Keys=multiplication)  # -> Keys, ValuesA
max_2 = Number(max)
item = ListItem(List=sort.Keys, Index=-1, Wrap=True)
division = Division(A=dist, B=item)
subtraction = Subtraction(A=1, B=division)
multiplication_2 = Multiplication(A=subtraction, B=max_2)
multiplication_3 = Multiplication(A=equals.Inequality, B=max_2)
multiplication_4 = Multiplication(A=equals.Equality, B=multiplication_2)
addition = Addition(A=multiplication_3, B=multiplication_4)
cir = Circle(Plane=move_2.Geometry, Radius=addition)
C = ClusterOutput(cir)
